# Grasshopper definition run_ViewCaptureToFile.ghx (Grasshopper 1.0.7)

panel = Panel("C:\Users\yoshioca\Documents\run_ViewCaptureToFile\out_panel_ghdoc.png")
panel_2 = Panel("C:\Users\yoshioca\Documents\run_ViewCaptureToFile\out_panel_str.png")
python = GhPythonScript()  # -> out, BREP
# ---------- python: Python ----------
import rhinoscriptsyntax as rs

def box_from_extrude(center, w, h, d):
    pl = rs.MovePlane(rs.WorldXYPlane(), center)
    rc = rs.AddRectangle(pl, w, h)
    rc_c = rs.CopyObject(rc)
    rc_mv = rs.MoveObject(rc_c, (w*(0.5)*(-1), h*(0.5)*(-1), 0))
    bx = rs.ExtrudeCurveStraight(rc_mv, (0,0,0), (0,0,d))
    cap_tf = rs.CapPlanarHoles(bx)
    return bx


#a = box_from_extrude((0, 0, 0), 10, 10, 10)
#a_geo = rs.coercebrep(box_from_extrude((0, 0, 0), 10, 10, 10))


bs = []

for i in xrange(10):
    bs.append(box_from_extrude((i*2,i*2, i*2), 10, 10, 10))


BREP = bs
# ---------- end python ----------
panel_3 = Panel(python.BREP)

# ---- group: Viewport Caputer
python_2 = GhPythonScript(INSERT=python.BREP, PATH_ghdoc=panel, PATH_str=panel_2, BOOL=Toggle(False))  # -> out; inputs INSERT: list
# ---------- python_2: Python ----------
import Rhino
import rhinoscriptsyntax as rs
import scriptcontext as sc
import ghpythonlib.components as ghpc



def brep_list_from_guid_list(brep_list):
    bl = []
    
    for i in xrange(len(brep_list)):
        bl.append(rs.coercebrep(brep_list[i]))
    
    return bl


breps = brep_list_from_guid_list(INSERT)
print(breps)



### (1) String on Python
#p = "C:\\Users\\yoshioca\\Documents\\run_ViewCaptureToFile\\out_python.png"
p = r"C:\Users\yoshioca\Documents\run_ViewCaptureToFile\out_python.png"

_path_ = p



### (2) Panel >> ghPython(ghdoc)
#_path_ = PATH_ghdoc


### (3) Panel >> ghPython()
#_path_ = PATH_str




sc.doc = ghdoc

if BOOL:
    
    sc.doc = Rhino.RhinoDoc.ActiveDoc
    for i in xrange(len(breps)):
        b = breps[i]
        print(b)
        sc.doc.Objects.AddBrep(b)
    
    
    query = "-ViewCaptureToFile "+ \
        " W=1080 H=1080 S=1 L=_No D=_No R=_No A=_No T=_No " + \
        _path_ + \
        " _Enter " + \
        " _SelAll _Delete"
        
    rs.Command(query)
    
    print(query)


sc.doc = ghdoc
# ---------- end python_2 ----------
